# Dynamo graph day-16-model-health-engine.dyn (Dynamo 3.3.0.6316)

categories = Categories("OST_Walls")
all_elements_of_category = ElementsOfCategory(Category=categories)
categories_2 = Categories("OST_Doors")
all_elements_of_category_2 = ElementsOfCategory(Category=categories_2)
file_path = Filename("..\..\Documents\GitHub\aec-cs-foundations\qa-rules.json")
file_from_path = FileObject(path=file_path)
readText = FileSystem.ReadText(file=file_from_path)
parseJSON = Data.ParseJSON(json=readText)
python_script = Python(IN[0]=all_elements_of_category, IN[1]=all_elements_of_category_2, IN[2]=parseJSON)  # CPython3
# ---------- python_script.python (112 lines) ----------
# Load the Python Standard and DesignScript Libraries
import sys
import clr
clr.AddReference('ProtoGeometry')
from Autodesk.DesignScript.Geometry import *

# The inputs to this node will be stored as a list in the IN variables.
dataEnteringNode = IN

# Place your code below this line

import sys
import clr
import datetime

# ---------------------------
# Force conversion helpers
# ---------------------------

def to_list(x):
    """
    Convert Dynamo / DesignScript / .NET inputs into plain Python lists.
    """
    if x is None:
        return []

    # Already a Python list
    if isinstance(x, list):
        return x

    # DesignScript / .NET collections
    try:
        return list(x)
    except:
        return [x]

# ---------------------------
# Inputs
# ---------------------------

walls_raw = IN[0]
doors_raw = IN[1]
rule_config = IN[2]  # Parsed JSON from Data.ParseJSON

walls = to_list(walls_raw)
doors = to_list(doors_raw)

items = {
    "Walls": walls,
    "Doors": doors
}

# ---------------------------
# Build report
# ---------------------------

report = {}

report["schema_version"] = rule_config["schema_version"]
report["report_type"] = "model_health"
report["generated_at"] = datetime.datetime.utcnow().isoformat() + "Z"

# ---------------------------
# Counts (now 100% safe)
# ---------------------------

counts = {
    "Walls": len(walls),
    "Doors": len(doors)
}

report["counts"] = counts

# ---------------------------
# Apply rules
# ---------------------------

issues = []

for rule in rule_config["rules"]:
    category = rule["category"]
    min_count = rule["min_count"]
    severity = rule["severity"]
    message = rule["message"]

    actual = counts.get(category, 0)

    if actual < min_count:
        issues.append({
            "severity": severity,
            "category": category,
            "message": message,
            "actual": actual,
            "expected_min": min_count
        })

# If no issues, add a success message
if not issues:
    issues.append({
        "severity": "info",
        "category": "model",
        "message": "All configured checks passed"
    })

report["issues"] = issues

report["metadata"] = {
    "generated_by": "Dynamo Python",
    "environment": "Local Revit Model"
}

OUT = report
# ----------------------------------------
