# Dynamo graph day-18-severity-filters-and-aggregation.dyn (Dynamo 3.3.0.6316)

categories = Categories("OST_Walls")
all_elements_of_category = ElementsOfCategory(Category=categories)
categories_2 = Categories("OST_Doors")
all_elements_of_category_2 = ElementsOfCategory(Category=categories_2)
file_path = Filename("..\..\Documents\GitHub\aec-cs-foundations\qa-rules.json")
file_from_path = FileObject(path=file_path)
readText = FileSystem.ReadText(file=file_from_path)
parseJSON = Data.ParseJSON(json=readText)
python_script = Python(IN[0]=all_elements_of_category, IN[1]=all_elements_of_category_2, IN[2]=parseJSON)  # CPython3
# ---------- python_script.python (112 lines) ----------
# Load the Python Standard and DesignScript Libraries
import sys
import clr
clr.AddReference('ProtoGeometry')
from Autodesk.DesignScript.Geometry import *

# The inputs to this node will be stored as a list in the IN variables.
dataEnteringNode = IN

# Place your code below this line

import datetime

# -------------------------------------------------
# Utilities
# -------------------------------------------------

def normalize_to_list(x):
    try:
        return list(x)
    except:
        return [x] if x else []


def count_elements(items_dict):
    counts = {}
    for category in items_dict:
        elements = normalize_to_list(items_dict[category])
        counts[category] = len(elements)
    return counts


def evaluate_rules(counts, rule_config):
    issues = []
    severity_counts = {
        "warning": 0,
        "error": 0
        }

    if "rules" not in rule_config:
        return issues, severity_counts

    rules_ds = rule_config["rules"]

    try:
        rules_list = list(rules_ds)
    except:
        rules_list = []

    for rule in rules_list:

        category = rule["category"]
        min_count = rule["min_count"]
        severity = rule["severity"]
        message = rule["message"]

        actual_count = counts.get(category, 0)

        if actual_count < min_count:
            issues.append({
                "severity": severity,
                "category": category,
                "message": message,
                "actual_count": actual_count,
                "expected_min": min_count
            })
            if severity in severity_counts:
                severity_counts[severity] += 1

    return issues, severity_counts


def build_report(counts, issues, severity_counts, rule_config):

    total_issues = len(issues)
    has_error = severity_counts["error"] > 0

    status = "FAIL" if has_error else "PASS"

    report = {
        "status": status,
        "summary": {
            "total_issues": total_issues,
            "warnings": severity_counts["warning"],
            "errors": severity_counts["error"]
        },
        "counts": counts,
        "issues": issues,
        "schema_version": rule_config.get("schema_version", "unknown"),
        "generated_at": datetime.datetime.utcnow().isoformat() + "Z"
    }

    return report

# -------------------------------------------------
# Main Execution
# -------------------------------------------------

items = {
    "Walls": IN[0],
    "Doors": IN[1]
}

rule_config = IN[2]

counts = count_elements(items)

issues, severity_counts = evaluate_rules(counts, rule_config)

report = build_report(counts, issues, severity_counts, rule_config)

OUT = report
# ----------------------------------------
