# Dynamo graph day-19-defensive-validation.dyn (Dynamo 3.3.0.6316)

categories = Categories("OST_Walls")
all_elements_of_category = ElementsOfCategory(Category=categories)
categories_2 = Categories("OST_Doors")
all_elements_of_category_2 = ElementsOfCategory(Category=categories_2)
file_path = Filename("..\..\Documents\GitHub\aec-cs-foundations\qa-rules.json")
file_from_path = FileObject(path=file_path)
readText = FileSystem.ReadText(file=file_from_path)
parseJSON = Data.ParseJSON(json=readText)
python_script = Python(IN[0]=all_elements_of_category, IN[1]=all_elements_of_category_2, IN[2]=parseJSON)  # CPython3
# ---------- python_script.python (144 lines) ----------
# Load the Python Standard and DesignScript Libraries
import sys
import clr
clr.AddReference('ProtoGeometry')
from Autodesk.DesignScript.Geometry import *

# The inputs to this node will be stored as a list in the IN variables.
dataEnteringNode = IN

# Place your code below this line

import datetime

# -------------------------------------------------
# Utilities
# -------------------------------------------------

def normalize_to_list(x):
    try:
        return list(x)
    except:
        return [x] if x else []


def count_elements(items_dict):
    counts = {}
    for category in items_dict:
        elements = normalize_to_list(items_dict[category])
        counts[category] = len(elements)
    return counts


def evaluate_rules(counts, rule_config):
    issues = []
    severity_counts = {
        "warning": 0,
        "error": 0
        }

    if "rules" not in rule_config:
        return issues, severity_counts

    rules_ds = rule_config["rules"]

    try:
        rules_list = list(rules_ds)
    except:
        rules_list = []

    
    for rule in rules_list:

        if not isinstance(rule, dict):
            issues.append({
                "severity": "error",
                "category": "config",
                "message": "Invalid rule format (expected dictionary)"
            })
            continue
    
        category = rule.get("category")
        min_count = rule.get("min_count", 0)
        severity = rule.get("severity", "warning")
        message = rule.get("message", "Rule violated")
    
        if not category:
            issues.append({
                "severity": "error",
                "category": "config",
                "message": "Rule missing category"
            })
            continue
    
        actual_count = counts.get(category, 0)
    
        if actual_count < min_count:
            issues.append({
                "severity": severity,
                "category": category,
                "message": message,
                "actual_count": actual_count,
                "expected_min": min_count
            })
    
            if severity in severity_counts:
                severity_counts[severity] += 1

    return issues, severity_counts


def build_report(counts, issues, severity_counts, rule_config):

    report = {}

    # Basic metadata
    report["schema_version"] = rule_config.get("schema_version", "unknown")
    report["report_type"] = "model_health"
    report["generated_at"] = datetime.datetime.utcnow().isoformat() + "Z"

    # Core data
    report["counts"] = counts
    report["issues"] = issues

    # Summary section
    total_issues = len(issues)
    report["summary"] = {
        "total_issues": total_issues,
        "severity_breakdown": severity_counts,
        "status": "FAIL" if severity_counts.get("error", 0) > 0 else "PASS"
    }

    # Metadata block
    report["metadata"] = {
        "generated_by": "Dynamo Python",
        "environment": "Local Revit Model"
    }

    return report


# -------------------------------------------------
# Main Execution
# -------------------------------------------------

try:
    items = {
        "Walls": IN[0],
        "Doors": IN[1]
    }

    rule_config = IN[2]

    counts = count_elements(items)
    issues, severity_counts = evaluate_rules(counts, rule_config)
    report = build_report(counts, issues, severity_counts, rule_config)

except Exception as e:
    report = {
        "report_type": "model_health",
        "error": str(e),
        "generated_at": datetime.datetime.utcnow().isoformat() + "Z"
    }

OUT = report
# ----------------------------------------
