# Dynamo graph model_helath.dyn "Dynamo Python" (Dynamo 3.3.0.6316)

categories = Categories("OST_Walls")
all_elements_of_category = ElementsOfCategory(Category=categories)
categories_2 = Categories("OST_Doors")
all_elements_of_category_2 = ElementsOfCategory(Category=categories_2)
python_script = Python(IN[0]=all_elements_of_category, IN[1]=all_elements_of_category_2)  # CPython3
# ---------- python_script.python (77 lines) ----------
# Load the Python Standard and DesignScript Libraries
import sys
import clr
clr.AddReference('ProtoGeometry')
from Autodesk.DesignScript.Geometry import *

# The inputs to this node will be stored as a list in the IN variables.
dataEnteringNode = IN

# Place your code below this line

import datetime

# Inputs from Dynamo
items = {
    "Walls": IN[0],
    "Doors": IN[1]
}

# Rule configuration (data, not logic)
rule_config = {
    "Walls": {
        "min_count": 1,
        "severity": "warning",
        "message": "No walls found (may be valid depending on model scope)"
    },
    "Doors": {
        "min_count": 1,
        "severity": "warning",
        "message": "No doors found (may be valid in early design stages)"
    }
}

report = {}

# Schema + timestamp
report["schema_version"] = "1.0"
report["report_type"] = "model_health"
report["generated_at"] = datetime.datetime.utcnow().isoformat() + "Z"

# Count elements
counts = {}
for category, elements in items.items():
    counts[category] = len(elements) if elements else 0

report["counts"] = counts

# Apply rules (generic engine)
issues = []

for category, rule in rule_config.items():
    count = counts.get(category, 0)

    if count < rule["min_count"]:
        issues.append({
            "severity": rule["severity"],
            "category": category,
            "message": rule["message"]
        })

# Info-level confirmation (optional but useful)
if issues == []:
    issues.append({
        "severity": "info",
        "category": "model",
        "message": "All configured checks passed"
    })

report["issues"] = issues

# Metadata
report["metadata"] = {
    "generated_by": "Dynamo Python",
    "environment": "Local Revit Model"
}

OUT = report
# ----------------------------------------
